# Grasshopper definition TweetPipe.ghx (Grasshopper 1.0.7)
# plug-ins: ShapeDiverForGrasshopper, BitmapComponent

imageformat = ValueList({"jpg", "png", "tiff", "bmp", "gif"}, selected="jpg")
textinput = DirectTextInput(maxlength=10000, text="TweetText")
tweetimage = ImportBitmap(maximum_file_size=10485760, selected_file_formats="image/bmp,image/gif,image/jpeg,image/png,image/tiff")  # -> Bitmap, Width, Height
txt = Text(textinput)
bmp = Bitmap(tweetimage.Bitmap)
exportimg = ImageExportOptions(Format=imageformat, QualityLevel=100)
concat = Concatenate(FragmentA="TweetReplyText", FragmentC=".", FragmentB=imageformat)
tweetreplytext = DirectDataOutput(Data=txt)
tweetreplyimage = DownloadExport(Data=bmp, Options=exportimg, Name=concat)
